# Grasshopper definition Sumer_AIA_GeoOpt_Assignment02_setup_SM_vs_bonus.gh (Grasshopper 1.0.7)
# plug-ins: Weaverbird

number_slider = Slider(20, range=1..20)
number_slider_2 = Slider(10, range=1..20)
python = GhPythonScript(x=Slider(10, range=1..20), y=Slider(10, range=1..20), U=number_slider, V=number_slider_2)  # -> out, a, c, d, e, f, g, h; inputs x: Int32, U: Int32, V: Int32
# ---------- python: Python ----------
import Rhino.Geometry as rg
import ghpythonlib.treehelpers as th
import math
import ghpythonlib.components as ghc

#this is how you initialize a list in python
pointList1 = []
pointList2 = []
for i in range(x):
    pt1 = rg.Point3d(i, 0, 0)
    pt2 = rg.Point3d(i, y, 0)
    pointList1.append(pt1)
    pointList2.append(pt2)

a = pointList1

lineList = []
for i in range(len(pointList1)):
    line = rg.Line(pointList1[i], pointList2[i])
    lineList.append(line)
c = lineList


allDivPts = []
for l in lineList:
    divPts = [] #my list of division points
    nc = l.ToNurbsCurve()
    params = nc.DivideByCount(V, True)
    for p in params:
        divPt = nc.PointAt(p)
        
        vec= rg.Vector3d(divPt)
        vecLen = vec.Length
        mag = math.sin(vecLen)
        transVec = -rg.Vector3d.ZAxis * mag
        
        newPt = divPt - transVec
        divPts.append(newPt)

    allDivPts.append(divPts)

d = th.list_to_tree(allDivPts)


#make a curve from list of points
curveList = []
for i in range(len(allDivPts)):
    curve = rg.Curve.CreateInterpolatedCurve(allDivPts[i], 3)
    curveList.append(curve)
e= curveList


#create a loft surface from curves
surface = rg.Brep.CreateFromLoft(curveList, rg.Point3d.Unset, rg.Point3d.Unset, rg.LoftType.Normal, False)
surface = surface[0].Faces[0]

f = surface

#reparametrize surface
surface.SetDomain(0,rg.Interval(0,U))
surface.SetDomain(1,rg.Interval(0,V))

#get points
allSrfPts=[]
for i in range(U+1):
    srfPts= []
    for j in range(V+1):
        pt=rg.Surface.PointAt(surface,i,j)
        srfPts.append(pt)
    allSrfPts.append(srfPts)
h = allSrfPts


mesh = rg.Mesh()
for i in range(len(allSrfPts)-1):
    for j in range(len(allSrfPts[i])-1):
        m = rg.Mesh()
        v1 = allSrfPts[i][j]
        v2 = allSrfPts[i][j+1]        
        v3 = allSrfPts[i+1][j+1]        
        v4 = allSrfPts[i+1][j]
        
        m.Vertices.Add(v1)
        m.Vertices.Add(v2)
        m.Vertices.Add(v3)
        m.Vertices.Add(v4)
        
        m.Faces.AddFace(0,1,2,3)
        
        mesh.Append(m)

g = mesh

cleanmesh = mesh
#methods to clean a mesh
cleanmesh.Normals.ComputeNormals()
cleanmesh.Vertices.CombineIdentical(True, True)
cleanmesh.Vertices.CullUnused()
cleanmesh.Weld(3.14159265358979)
cleanmesh.UnifyNormals()
cleanmesh.FaceNormals.ComputeFaceNormals()
cleanmesh.Compact()


h = cleanmesh
# ---------- end python ----------

# ---- group: create sun Vector
python_2 = GhPythonScript(
    x=Slider(0.1, range=0..1),
    y=Slider(0.5, range=0..1),
    month=Slider(1, range=1..12),
    day=Slider(1, range=1..31),
    hour=Slider(0, range=0..12),
    minute=Slider(0, range=0..60))  # -> out, a, b, c; inputs month: Int32, minute: Int32
# ---------- python_2: Python ----------
import Rhino.Geometry as rg
import math
import Rhino.Render.Sun as sun
import ghpythonlib.components as ghp
import Rhino

#create a sun vector
#off = (location.split("\n"))[4]
#offset = off.split(",")[0]
#offset = int(math.ceil(float(offset)))

date = ghp.ConstructDate(2021, month, day, hour, minute, 0)
mySun = Rhino.Render.Sun()
Rhino.Render.Sun.SetPosition(mySun, date, x*math.pi, y*math.pi)

#Altitude = mySun.Altitude
#Azimuth = mySun.Azimuth

sVec = Rhino.RhinoDoc.ActiveDoc.Lights.Sun.Vector
sunobj=Rhino.RhinoDoc.ActiveDoc.Lights.Sun

#Rhino.RhinoDoc.ActiveDoc.Lights.Sun in a variable and change the latitude and longitude properties of that object
#sun.Enabled.SetValue(sunPosition,True)
#sun.TimeZone.SetValue(sunPosition, offset)
sunvector=mySun.Vector

#1. create a Sphere at point (0,0,0) with radius 1 and output it to a
#output the sphere to a

point = rg.Point3d(0,0,0)
a = rg.Sphere(point, 1)
#a = sphere

#a = rg.Sphere.ToNurbsSurface(a)
#rg.Surface.SetDomain(a, 0, rg.Interval(0,1))

#2. evaluate a point in the sphere using rg.Sphere.PointAt() at coordintes x and y
#the point should only be on the upper half of the sphere (upper hemisphere)
#the angles are in radians, so you might want to use math.pi for this
#output the point to b

#point = rg.Surface.PointAt(a, x, y)
#point=rg.Sphere.PointAt(a, (x*(22/7)/180), (y*(22/7)/180))
point=rg.Sphere.PointAt(a, (x*math.pi), (y*math.pi))
b = point

#create a vector from the origin  and reverse the vector
#keep in mind that Reverse affects the original vector
#output the vector to c

vec = rg.Vector3d(point)
rg.Vector3d.Reverse(vec)
c = vec
# ---------- end python_2 ----------

# ----
data = Data(python_2.a)
number_slider_3 = Slider(1, range=0..1)
vdis = VectorDisplay(Anchor=python_2.b, Vector=python_2.c)

# ---- group: your .py file goes here
# Assignment 2
path = FilePath("G:\My Drive\AIA Geo Opt\A02\a02_SM.py")

# ---- group: replaceable mesh
mesh = Data(python.h)

# ----
file = ReadFile(File=path, PerLineParse=False)
python_3 = GhPythonScript(
    Code=file,
    M=mesh,
    S=python_2.c,
    Vec_length=number_slider_3,
    U=number_slider,
    V=number_slider_2,
    Min_off=Slider(0.06, range=0..0.5),
    Max_off=Slider(0.12, range=0..1),
    Height=Slider(0.07, range=0..0.1),
    Width=Slider(0.12, range=0..0.2))  # -> Out, A, B, C, D, Joined_outlines, Offset_outlines, Lofted_breps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
data_2 = Data(python_3.Joined_outlines)
data_3 = Data(python_3.Offset_outlines)
data_4 = Data(python_3.Polylines_1)
data_5 = Data(python_3.Polylines_2)
vdis_2 = VectorDisplay(Anchor=python_3.B, Vector=python_3.A)
list_item = ListItem(List=data_2, Index=Slider(0, range=0..400), Wrap=True)
curve = Curve(list_item)
bnd = Bounds(Numbers=python_3.C)

# ---- group: Mesh Vertex Normals
# Geometry Outcome
vector_display = VectorDisplay(Anchor=python_3.Vert, Vector=python_3.E)

# ---- group: Lofted Cones
data_6 = Data(python_3.Lofted_cones)

# ---- group: Lofted Base
data_7 = Data(python_3.Lofted_breps)

# ----
# BONUS: BUILD A FRAME
data_8 = Data(python_3.Beams_1)
data_9 = Data(python_3.Beams_2)

dedomain = DeconstructDomain(Domain=bnd)  # -> Start, End
gradient = Gradient(
    LowerLimit=dedomain.Start,
    UpperLimit=dedomain.End,
    Parameter=python_3.C,
    stops=[0: RGB(234, 38, 0), 0.25: RGB(234, 126, 0), 0.5: RGB(254, 244, 84), 0.75: RGB(173, 203, 249), 1: RGB(75, 107, 169)])
merge = Merge(Data1=flatten(data_7), Data2=data_6, Data3=python_3.D)
bnd_2 = Bounds(Numbers=python_3.C)
dedomain_2 = DeconstructDomain(Domain=bnd_2)  # -> Start, End
preview = CustomPreview(Geometry=merge, Material=gradient)
gradient_2 = Gradient(
    LowerLimit=dedomain_2.Start,
    UpperLimit=dedomain_2.End,
    Parameter=python_3.C,
    stops=[0: RGB(0, 98, 0), 0.25: RGB(81, 175, 17), 0.5: RGB(159, 198, 146), 0.75: RGB(170, 235, 41), 1: RGB(221, 255, 53)])
merge_2 = Merge(Data1=data_8, Data2=data_9)
preview_2 = CustomPreview(Geometry=merge_2, Material=gradient_2)

# ----
# BONUS MESH
number_slider_4 = Slider(50, range=0..10000)
mesh_2 = Mesh(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)
unit_y = UnitY(Factor=number_slider_4)
wbcatmullclark = WeaverbirdsCatmullClarkSubdivision(MeshCurves=mesh_2, Level=1, SmoothNakedEdges=1)
move = Move(Geometry=wbcatmullclark, Motion=unit_y)  # -> Geometry, Transform
quad_remesh_settings = QuadRemeshSettings(
    TargetCount=Slider(500, range=0..1000),
    AdaptiveSize=0,
    AdaptiveCount=False,
    HardEdges=False,
    SeamEdges=0,
    Symmetry=0,
    GuideCurves=0)
path_2 = FilePath("G:\My Drive\AIA Geo Opt\A02\a02_SM bonus.py")
quad_remesh = QuadRemesh(Mesh=move.Geometry, Settings=quad_remesh_settings)
file_2 = ReadFile(File=path_2, PerLineParse=False)
python_4 = GhPythonScript(
    Code=file_2,
    M=quad_remesh,
    S=python_2.c,
    Vec_length=number_slider_3,
    U=Slider(24, range=0..100),
    V=Slider(24, range=0..100),
    Min_off=Slider(0.08, range=0..0.5),
    Max_off=Slider(0.33, range=0..1))  # -> Out, A, B, C, D, Joined_outlines, Outlines, Mesh_points_3d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
data_10 = Data(python_4.Offset_outlines)
data_11 = Data(python_4.Circles)
data_12 = Data(python_4.Moved_circles)
data_13 = Data(python_4.Mesh_points_3d)
data_14 = Data(python_4.Joined_outlines)
data_15 = Data(python_4.Outlines)
vdis_3 = VectorDisplay(Anchor=python_4.B, Vector=python_4.A)
bnd_3 = Bounds(Numbers=python_4.C)
dedomain_3 = DeconstructDomain(Domain=bnd_3)  # -> Start, End
gradient_3 = Gradient(
    LowerLimit=dedomain_3.Start,
    UpperLimit=dedomain_3.End,
    Parameter=python_4.C,
    stops=[0: RGB(234, 38, 0), 0.25: RGB(234, 126, 0), 0.5: RGB(254, 244, 84), 0.75: RGB(173, 203, 249), 1: RGB(75, 107, 169)])

# ---- group: Lofted Cones
data_16 = Data(python_4.Lofted_cones)

# ---- group: Mesh Vertex Normals
# Bonus Mesh: Geometry Outcome
vdis_4 = VectorDisplay(Anchor=python_4.Vert, Vector=python_4.E)

# ----
merge_3 = Merge(Data1=python_4.D, Data2=flatten(data_16))
preview_3 = CustomPreview(Geometry=merge_3, Material=gradient_3)
